# Dynamo graph Surface from 3 or 4 Corner Points.dyn (Dynamo 2.17.4.5316)

select_3_or_4_corner_points = SelectNode(SelectionFilter=4)  # graph input
count = List.Count(list=select_3_or_4_corner_points)
code_block = CodeBlock { 4; }
eq = count == code_block
code_block_2 = CodeBlock { 0; }
if_ = RefactoredIf(test=eq, true=code_block_2, false=select_3_or_4_corner_points)
watch = Watch(if_)
keep_input_points = BoolSelector(true)  # graph input

# group: 3 Point surface
byPerimeterPoints = Surface.ByPerimeterPoints(points=watch)
send_to_alias = BakeNode(byPerimeterPoints, select_3_or_4_corner_points, Boolean=keep_input_points)  # graph output

# group: Checking Number of points
code_block_3 = CodeBlock { 3; }
ge = count >= code_block_3
code_block_4 = CodeBlock { "Select 3 or 4 points"; }
if_2 = RefactoredIf(test=ge, true=select_3_or_4_corner_points, false=code_block_4)
send_message_to_alias = MessageNode(String=if_2)

watch_2 = Watch(count)
if_3 = RefactoredIf(test=eq, true=select_3_or_4_corner_points, false=code_block_2)
watch_3 = Watch(if_3)
code_block_5 = CodeBlock { 0; }
getItemAtIndex = List.GetItemAtIndex(list=watch_3, index=code_block_5)
code_block_6 = CodeBlock { 1; }
getItemAtIndex_2 = List.GetItemAtIndex(list=watch_3, index=code_block_6)
byStartPointEndPoint = Line.ByStartPointEndPoint(startPoint=getItemAtIndex, endPoint=getItemAtIndex_2)
code_block_7 = CodeBlock { 2; }
getItemAtIndex_3 = List.GetItemAtIndex(list=watch_3, index=code_block_7)
code_block_8 = CodeBlock { 3; }
getItemAtIndex_4 = List.GetItemAtIndex(list=watch_3, index=code_block_8)
byStartPointEndPoint_2 = Line.ByStartPointEndPoint(startPoint=getItemAtIndex_3, endPoint=getItemAtIndex_4)
list_create = List.Create(item0=byStartPointEndPoint, item1=byStartPointEndPoint_2)
byLoft = Surface.ByLoft(crossSections=list_create)
send_to_alias_2 = BakeNode(byLoft, select_3_or_4_corner_points, Boolean=keep_input_points)  # graph output
